# Dynamo graph Revit_subtract_light_cones.dyn

file_path = StringFilename("C:\dev\Generative-drop-ceiling\Python\porus_light_cone_subtraction.py")
read_text_file = FileReader(file_path)
file_path_2 = StringFilename("C:\dev\Generative-drop-ceiling\Python\Read_txtfile_from_pointlist_to_bsplinesurface.py")
read_text_file_2 = FileReader(file_path_2)
file_path_3 = StringFilename("C:\dev\Generative-drop-ceiling\Exported_TxtFiles\planarQuad_textfile5.txt")
read_text_file_3 = FileReader(file_path_3)
python_script_from_string = PythonString(read_text_file_2, read_text_file_3)
flatten_completely = FlattenList(python_script_from_string)
file_path_4 = StringFilename("C:\dev\Generative-drop-ceiling\Python\get_geometry_transaction_test.py")
read_text_file_4 = FileReader(file_path_4)
number = DoubleInput(2)
file_path_5 = StringFilename("C:\dev\Generative-drop-ceiling\Python\revit_geometry_sorter.py")
read_text_file_5 = FileReader(file_path_5)
lighting_elements = MultipleCurvesBySelection()  # 10 picked in the model
python_script_from_string_2 = PythonString(read_text_file_5, lighting_elements)
get_from_list = GetFromList(number, python_script_from_string_2)
watch = Watch(get_from_list)
python_script_from_string_3 = PythonString(read_text_file_4, watch)
python_script = Python(python_script_from_string_3)
# ---------- python_script.python (11 lines) ----------
#The input to this node will be stored in the IN variable.
dataEnteringNode = IN
surfaces = IN

points = []
for surf in surfaces:
	points.append( surf.point_at_parameter( 0.5, 0.5 ) )
	
	
#Assign your output to the OUT variable
OUT = points
# ----------------------------------------
draw = ForceDrawNode(python_script, lacing=Longest)
file_path_6 = StringFilename("C:\dev\Generative-drop-ceiling\maple_mockup\planar_solids.sat")
import_sat = ImportSATNode(file_path_6, lacing=Longest)
list = NewList(index0=flatten_completely, index1=draw, index2=import_sat)
python_script_from_string_4 = PythonString(read_text_file, list)
watch_2 = Watch(python_script_from_string_4)
python_script_2 = Python()
# ---------- python_script_2.python (79 lines) ----------
import System
from System import *
import math
import sys
path = 'C:\\Users\\t_nguyp\\Desktop\\Dynamo\\Release'
sys.path.append(path)
import clr
clr.AddReference('LibGNet')
from Autodesk.LibG import *

from Autodesk.LibG import Point,Line,Surface,Polygon,Geometry,Vector,Solid
#The input to this node will be stored in the IN variable.
dataEnteringNode = IN


def length(v):
  return math.sqrt(v.dot(v))

def vector_angle(v1, v2):
	radians = math.acos(v1.dot(v2) / (length(v1) * length(v2)))
	return (radians * 180)/ math.pi
  
def vector_create( point_to , point_from ):
   
    vec_x = (point_to.x() - point_from.x()) / 2 
    vec_y = (point_to.y() - point_from.y()) / 2 
    vec_z = (point_to.z() - point_from.z()) / 2 
    
    final_vec = Vector.from_xyz( vec_x, vec_y, vec_z )
    
    return final_vec
    
def move_point_byvector( point, vector, magnitude ):
    vector_copy = Vector.by_coordinates(vector.x(),vector.y(),vector.z())
    vector_copy.normalize()
       
    newpoint = [0,0,0]
    newpoint[0] = point.x() + (vector_copy.x() * magnitude)
    newpoint[1] = point.y() + (vector_copy.y() * magnitude)
    newpoint[2] = point.z() + (vector_copy.z() * magnitude)
    
    finalpt = Point.by_coordinates(newpoint[0], newpoint[1], newpoint[2])
    return finalpt


surface_points = IN[0]
light = IN[1]
solids = IN[2]
tolerence = 200

"""
for surface in Surfaces:
	for i in range(8):
		rand_num1 = (rand.Next(125, 875))/1000.0
		rand_num2 = (rand.Next(125, 875))/1000.0
		
		test.append(surface.point_at_parameter( rand_num1, rand_num2 ))
"""

objs = []
for point in surface_points:
	test_point = Point.by_coordinates(point.x(),point.y(),light.z())
	dist = test_point.distance_to(light)
	
	if dist >= tolerence:
		continue
		
	lower_pt = Point.by_coordinates(light.x(), light.y(), light.z() - 1)
	Zcomparision_vector = vector_create( lower_pt , light )
	vec = vector_create( point, light )
	angle = vector_angle(vec, Zcomparision_vector)
	
	if angle <= 60:
		new_point = move_point_byvector( point, vec, 10 )
		objs.append(Cone.by_points_radius( light , new_point, 0.1, 3.0))

#Assign your output to the OUT variable

OUT = objs
# ----------------------------------------
watch_3 = Watch(python_script)
watch_4 = Watch(python_script_from_string_2)
file_path_7 = StringFilename("C:\dev\Generative-drop-ceiling\Final_mockup\lightPoints.txt")
read_text_file_6 = FileReader(file_path_7)
python_script_3 = Python(read_text_file_6)
# ---------- python_script_3.python (23 lines) ----------
import sys
path = 'C:\\dev\\Dynamo\\bin\\Release'
sys.path.append(path)
import clr
clr.AddReference('LibGNet')
from Autodesk.LibG import *

from Autodesk.LibG import Point,Line,Surface,Polygon,Geometry

#The input to this node will be stored in the IN variable.
dataEnteringNode = IN

text = IN
pointlist = []
split_text = text.split("\n")

for i in range(len(split_text)):
	xyz = split_text[i].split(",")
	pointlist.append( Point.by_coordinates( float(xyz[0]), float(xyz[1]), float(xyz[2])) )
	

#Assign your output to the OUT variable
OUT = pointlist
# ----------------------------------------
watch_5 = Watch(python_script_3)
string = StringInput("C:\dev\Generative-drop-ceiling\maple_mockup\final_tester")
draw_2 = ForceDrawNode(python_script_from_string_4, lacing=Longest)
watch_3d = Watch3D(draw_2)
export_to_sat = ExportSATNode(string, watch_3d, lacing=Longest)
string_2 = StringInput("C:\dev\Generative-drop-ceiling\Python\Read_txtfile_from_pointlist_to_bsplinesurface")
string_3 = StringInput("C:\dev\Generative-drop-ceiling\Exported_TxtFiles\planarQuad_textfile5")
string_4 = StringInput("C:\dev\Generative-drop-ceiling\maple_mockup\planar_solids")
string_5 = StringInput("C:\dev\Generative-drop-ceiling\Python\revit_geometry_sorter")
string_6 = StringInput("C:\dev\Generative-drop-ceiling\Python\get_geometry_transaction_test")
string_7 = StringInput("C:\dev\Generative-drop-ceiling\Python\porus_light_cone_subtraction")
watch_6 = Watch(python_script_from_string)
