# Dynamo graph Sorted_revit_geo_to_solids_to_ceiling.dyn

file_path = StringFilename("C:\dev\Generative-drop-ceiling\Python\get_geometry_transaction_test.py")
read_text_file = FileReader(file_path)
file_path_2 = StringFilename("C:\dev\Generative-drop-ceiling\Python\revit_geometry_sorter.py")
read_text_file_2 = FileReader(file_path_2)
select_elements = MultipleCurvesBySelection()  # 776 picked in the model
python_script_from_string = PythonString(read_text_file_2, select_elements)
watch = Watch(python_script_from_string)
python_script_from_string_2 = PythonString(read_text_file, watch)
watch_2 = Watch(python_script_from_string_2)
draw = ForceDrawNode(lacing=Longest)
file_path_3 = StringFilename("C:\dev\Generative-drop-ceiling\Python\overall_geometry_boundingbox.py")
read_text_file_3 = FileReader(file_path_3)
python_script_from_string_3 = PythonString(read_text_file_3, select_elements)
watch_3 = Watch(python_script_from_string_3)
draw_2 = ForceDrawNode(watch_3, lacing=Longest)
number_slider = DoubleSliderInput(10, range=0..200)
list = NewList(index0=watch_3, index1=number_slider, index2=python_script_from_string_2)
watch_4 = Watch(list)
python_script = Python()
# ---------- python_script.python (16 lines) ----------
#The input to this node will be stored in the IN variable.
dataEnteringNode = IN

min_point = IN[0][0] #min point & also start point
max_point = IN[0][1] #max point

panel_sizing = IN[1] # Panel Sizing
reference_geo = []
reference_geo.extend(IN[2]) #standard geom to avoid.
reference_geo.append(IN[0][2]) #top_surface

xLength = max_point.x() - min_point.y()
ylength = max_point.x() - min_point.y()

#Assign your output to the OUT variable
OUT = xLength
# ----------------------------------------
file_path_4 = StringFilename("C:\dev\Generative-drop-ceiling\Python\drop_ceiling_optimization_v5.py")
read_text_file_4 = FileReader(file_path_4)
python_script_from_string_4 = PythonString(read_text_file_4, list)
watch_5 = Watch(python_script_from_string_4)
draw_3 = ForceDrawNode(python_script_from_string_4, lacing=Longest)
watch_3d = Watch3D(draw_3)
python_script_2 = Python()
# ---------- python_script_2.python (6 lines) ----------
#The input to this node will be stored in the IN variable.
dataEnteringNode = IN

solids = IN[3]
#Assign your output to the OUT variable
OUT = solids
# ----------------------------------------
extract_solid_from_element = ElementSolid(python_script_2, lacing=Longest)
