# Dynamo graph ceiling_subdivision.dyn

file_path = StringFilename("C:\dev\Generative-drop-ceiling\Python\Subdivide.py")
read_text_file = FileReader(file_path)
file_path_2 = StringFilename("C:\dev\Generative-drop-ceiling\Media\testgeo.sat")
import_sat = ImportSATNode(file_path_2, lacing=Longest)
python_script_from_string = PythonString(read_text_file, import_sat)
watch = Watch(python_script_from_string)
watch_2 = Watch(import_sat)
watch_3d = Watch3D(import_sat)
draw = ForceDrawNode(python_script_from_string, lacing=Longest)
watch_3d_2 = Watch3D(draw)
