# Dynamo graph get_revit_geo_test.dyn

select_model_element = ModelElementSelection()  # 1 picked in the model
watch = Watch(select_model_element)
select_elements = MultipleCurvesBySelection()  # 32 picked in the model
python_script = Python(select_elements)
# ---------- python_script.python (12 lines) ----------
#The input to this node will be stored in the IN variable.
dataEnteringNode = IN

objects = IN
for obj in objects:
	#test = obj.GetOriginalGeometry(Options())
	#.get_Geometry(Options())
	test = 0


#Assign your output to the OUT variable
OUT = objects
# ----------------------------------------
watch_2 = Watch(python_script)
list = NewList(index0=python_script)
draw = ForceDrawNode(list, lacing=Longest)
watch_3d = Watch3D(draw)
extract_solid_from_element = ElementSolid(select_model_element, lacing=CrossProduct)
watch_3 = Watch(extract_solid_from_element)
